# Grasshopper definition ass1.hops.gh (Grasshopper 1.0.8)

number6 = GetNumber(Slider(-15, range=-15..100), AtLeast=1, AtMost=1, Maximum=1.797693135e+308, Minimum=-1.797693135e+308, TreeAccess=False)
number5 = GetNumber(Slider(15, range=-15..100), AtLeast=1, AtMost=1, Maximum=1.797693135e+308, Minimum=-1.797693135e+308, TreeAccess=False)
number3 = GetNumber(Slider(15, range=-15..100), AtLeast=1, AtMost=1, Maximum=1.797693135e+308, Minimum=-1.797693135e+308, TreeAccess=False)
number4 = GetNumber(Slider(-15, range=-15..100), AtLeast=1, AtMost=1, Maximum=1.797693135e+308, Minimum=-1.797693135e+308, TreeAccess=False)
number2 = GetNumber(Slider(15, range=0..100), AtLeast=1, AtMost=1, Maximum=1.797693135e+308, Minimum=-1.797693135e+308, TreeAccess=False)
number1 = GetNumber(Slider(-15, range=-15..100), AtLeast=1, AtMost=1, Maximum=1.797693135e+308, Minimum=-1.797693135e+308, TreeAccess=False)
construct_domain = ConstructDomain(DomainStart=number5, DomainEnd=number6)
construct_domain_2 = ConstructDomain(DomainStart=number3, DomainEnd=number4)
construct_domain_3 = ConstructDomain(DomainStart=number1, DomainEnd=number2)
construct_point = ConstructPoint(XCoordinate=0, YCoordinate=0, ZCoordinate=0)
domain_box = DomainBox(Base=PlaneXY(0, 0, 0), X=construct_domain_3, Y=construct_domain_2, Z=construct_domain)
line_sdl = LineSDL(Start=construct_point, Direction=Vector(0, 0, 1), Length=number6)
twist = Twist(Geometry=domain_box, Axis=line_sdl, Angle=degrees(Slider(95, range=0..100)), Infinite=False, Rigid=False)
deconstruct_brep = DeconstructBrep(Brep=twist)  # -> Faces, Edges, Vertices
mesh = Mesh(deconstruct_brep.Faces)
context_bake = ContextBake(Content=mesh)
